# Grasshopper definition test-BIG.gh (Grasshopper 1.0.7)

number_slider = Slider(200, range=0..500)
number_slider_2 = Slider(15, range=0..20)
pt = Point(Point(75.379609, 1.239496838, 0))
pi = Pi(Factor=Slider(5, range=0..12))
dom = ConstructDomain(DomainStart=Slider(2, range=1..10), DomainEnd=number_slider_2)
range = Range(Domain=pi, Steps=number_slider)
xy = XYPlane(Origin=pt)
range_2 = Range(Domain=dom, Steps=number_slider)
pt_2 = PointCylindrical(BasePlane=xy, Angle=range, Radius=range_2, Elevation=0)
rotate = Rotate(Geometry=pt_2, Angle=degrees("180"), Plane=xy)  # -> Geometry, Transform
nurbs = NurbsCurve(Vertices=pt_2, Degree=3, Periodic=False)  # -> Curve, Length, Domain
nurbs_2 = NurbsCurve(Vertices=rotate.Geometry, Degree=3, Periodic=False)  # -> Curve, Length, Domain
entwine = Entwine(Branch00=nurbs.Curve, Branch01=nurbs_2.Curve, FlattenInputs=True)
xy_2 = XYPlane(Origin=pt)
prot = RotatePlane(Plane=xy_2, Angle=degrees(Slider(45, range=0..360)))
scale_nu = ScaleNU(Geometry=entwine, Plane=prot, ScaleX=Slider(1.3, range=1..2), ScaleY=Slider(1, range=1..2), ScaleZ=1)  # -> Geometry, Transform
bang = ExplodeTree(Data=scale_nu.Geometry)  # -> Branch0, Branch1
eval = EvaluateCurve(Curve=scale_nu.Geometry, Parameter="0")  # -> Point, Tangent, Angle
Z = UnitZ(Factor=1)
entwine_2 = Entwine(Branch00=bang.Branch1, Branch01=bang.Branch0, FlattenInputs=True)
xprod = CrossProduct(VectorA=eval.Tangent, VectorB=Z, Unitize=False)  # -> Vector, Length
vdis = VectorDisplay(Anchor=eval.Point, Vector=xprod.Vector)
project = ProjectPoint(Point=eval.Point, Direction=xprod.Vector, Geometry=entwine_2)  # -> Point, Index
crv_cp = CurveClosestPoint(Point=project.Point, Curve=entwine_2)  # -> Point, Parameter, Distance
addition = Addition(A=crv_cp.Parameter, B=Slider(0, range=0..90))
shatter = Shatter(Curve=entwine_2, Parameters=addition)
len = Length(Curve=shatter)
sort = SortList(Keys=len, ValuesA=shatter)  # -> Keys, reverse(ValuesA)
number_slider_3 = Slider(200, range=1..800)
item = ListItem(List=sort.ValuesA, Index=0, Wrap=True)
hframes = HorizontalFrames(Curve=item, Count=number_slider_3)  # -> Frames, Parameters
deplane = DeconstructPlane(Plane=hframes.Frames)  # -> Origin, XAxis, YAxis, ZAxis
range_3 = Range(Domain="0 to 1", Steps=number_slider_3)
number_slider_4 = Slider(4, range=0..10)
graph = GraphMapper(range_3, x0=0, x1=1, y0=0, y1=1, container_name="Gaussian", factor=0.2798700929, mean=0.5, sdev=0.1596237421)
project_2 = ProjectPoint(Point=deplane.Origin, Direction=deplane.YAxis, Geometry=scale_nu.Geometry)  # -> Point, Index
bnd = Bounds(Numbers=graph)
ln = Line(StartPoint=project_2.Point, EndPoint=hframes.Frames)
dom_2 = ConstructDomain(DomainStart=number_slider_4, DomainEnd=Slider(7, range=0..10))
remap = RemapNumbers(Value=graph, Source=bnd, Target=dom_2)  # -> Mapped, Clipped
Z_2 = UnitZ(Factor=remap.Mapped)
move = Move(Geometry=ln, Motion=Z_2)  # -> Geometry, Transform
entwine_3 = Entwine(Branch0X=ln, Branch1X=move.Geometry, FlattenInputs=False)  # -> simplify(Result)
loft = Loft(Curves=ln, Options={Adjust=False, Closed=False, LoftEnds=0, LoftSimp=0, LoftType=0, Rebuild=10, Refit=0.01})
loft_2 = Loft(Curves=move.Geometry, Options={Adjust=False, Closed=False, LoftEnds=0, LoftSimp=0, LoftType=0, Rebuild=10, Refit=0.01})
loft_3 = Loft(Curves=entwine_3, Options={Adjust=False, Closed=False, LoftEnds=0, LoftSimp=0, LoftType=0, Rebuild=10, Refit=0.01})
number_slider_5 = Slider(0.3, range=0..1)
crv = Curve(loft)
crv_2 = Curve(loft_3)
runion = RegionUnion(Curves=flatten(crv))
explode = Explode(Curve=crv_2, Recursive=True)  # -> simplify(Segments), Vertices
area = Area(Geometry=runion)  # -> Area, Centroid
Z_3 = UnitZ(Factor=number_slider_4)
panel = Panel(explode.Segments)
sort_2 = SortList(Keys=area.Area, ValuesA=runion)  # -> Keys, reverse(ValuesA)
end = EndPoints(Curve=move.Geometry)  # -> Start, End
item_2 = ListItem(List=sort_2.ValuesA, Index="1", Wrap=True)
boundary = BoundarySurfaces(Edges=item_2)
tmatch = MatchText(Text=panel, Pattern="Line*", Case=True)
move_2 = Move(Geometry=boundary, Motion=Z_3)  # -> Geometry, Transform
dispatch = Dispatch(List=explode.Segments, DispatchPattern=tmatch)  # -> ListA, ListB
merge = Merge(Data1=loft_2, Data2=move_2.Geometry)  # -> flatten(Result)
crv_3 = Curve(move_2.Geometry)
crv_4 = Curve(dispatch.ListA)
crv_5 = Curve(dispatch.ListB)
join = BrepJoin(Breps=merge)  # -> Breps, Closed
explode_2 = Explode(Curve=crv_3, Recursive=True)  # -> Segments, Vertices
path_mapper = PathMapper(crv_5, source="{A;B}(i)", target="{i;B}(A)")
path_mapper_2 = PathMapper(crv_4, source="{A;B}(i)", target="{i;B}(A)")
intcrv = Interpolate(Vertices=end.End, Degree=3, Periodic=False, KnotStyle=1)  # -> Curve, Length, Domain
intcrv_2 = Interpolate(Vertices=end.Start, Degree=3, Periodic=False, KnotStyle=1)  # -> Curve, Length, Domain
xy_3 = XYPlane(Origin=pt)
Z_4 = UnitZ(Factor=number_slider_5)
Z_5 = UnitZ(Factor=number_slider_5)
panel_2 = Panel(explode_2.Segments)
rev = Reverse(Vector=Z_4)
end_2 = EndPoints(Curve=intcrv_2.Curve)  # -> Start, End
extr = Extrude(Base=join.Breps, Direction=Z_5)
loft_4 = Loft(Curves=path_mapper_2, Options={Adjust=False, Closed=False, LoftEnds=0, LoftSimp=0, LoftType=0, Rebuild=10, Refit=0.01})
merge_2 = Merge(Data1=end_2.Start, Data2=end_2.End)
loft_5 = Loft(Curves=path_mapper, Options={Adjust=False, Closed=False, LoftEnds=0, LoftSimp=0, LoftType=0, Rebuild=10, Refit=0.01})
move_3 = Move(Geometry=xy_3, Motion=rev)  # -> Geometry, Transform
tmatch_2 = MatchText(Text=panel_2, Pattern="Line*", Case=True)
project_3 = Project(Geometry=merge_2, Plane=move_3.Geometry)  # -> Geometry, Transform
preview = CustomPreview(Geometry=extr, Material=ColourSwatch(SwatchColor=RGB(232, 232, 232)))
cull = CullPattern(List=explode_2.Segments, CullPattern=invert(tmatch_2))
ln_2 = Line(StartPoint=merge_2, EndPoint=project_3.Geometry)
merge_3 = Merge(Data1=cull, Data2=intcrv.Curve)  # -> flatten(Result)
merge_4 = Merge(Data1=intcrv_2.Curve, Data2=ln_2)
join_2 = JoinCurves(Curves=merge_3, Preserve=False)  # -> simplify(graft(Curves))
join_3 = JoinCurves(Curves=merge_4, Preserve=False)  # -> simplify(Curves)
bang_2 = ExplodeTree(Data=loft_5)  # -> Branch0, Branch1, Branch2, Branch3
bang_3 = ExplodeTree(Data=join_2)  # -> Branch0, Branch1
bang_4 = ExplodeTree(Data=join_3)  # -> Branch0, Branch1
srf = Surface(bang_2.Branch0)
srf_2 = Surface(bang_2.Branch1)
srf_3 = Surface(bang_2.Branch2)
srf_4 = Surface(bang_2.Branch3)
crv_6 = Curve(bang_3.Branch0)
crv_7 = Curve(bang_3.Branch1)
crv_8 = Curve(bang_4.Branch0)
crv_9 = Curve(bang_4.Branch1)
entwine_4 = Entwine(Branch00=crv_7, Branch01=crv_6, Branch02=crv_9, Branch03=crv_8, FlattenInputs=True)
Z_6 = UnitZ(Factor=number_slider_5)
move_4 = Move(Geometry=entwine_4, Motion=Z_6)  # -> Geometry, Transform
srfsplit = SurfaceSplit(Surface=loft_5, Curves=move_4.Geometry)
pt_3 = Point(pt)
debrep = DeconstructBrep(Brep=srfsplit)  # -> Faces, Edges, simplify(Vertices)
graft = GraftTree(Tree=srfsplit, IncludeEmptyLists=True, IncludeNullItems=True)
num = Number(number_slider_2)
pdecon = Deconstruct(Point=debrep.Vertices)  # -> XComponent, YComponent, ZComponent
pdecon_2 = Deconstruct(Point=pt_3)  # -> XComponent, YComponent, ZComponent
pull = PullPoint(Point=debrep.Vertices, Geometry=pt_3, ClosestOnly=True)  # -> ClosestPoint, Distance
sort_3 = SortList(Keys=pull.Distance)  # -> Keys, ValuesA
equals = Equality(FirstNumber=pdecon.ZComponent, SecondNumber=pdecon_2.ZComponent)  # -> Equality, Inequality
multiplication = Multiplication(A=num, B=Slider(0.7, range=0..1))
item_3 = ListItem(List=sort_3.Keys, Index=0, Wrap=True)
ma = MassAddition(Input=equals.Equality)  # -> Result, PartialResults
larger = LargerThan(FirstNumber=item_3, SecondNumber=multiplication)  # -> LargerThan, OrEqualTo
bool = Boolean(invert(ma.Result))
or = GateOr(A=bool, B=larger.LargerThan)
cull_2 = CullPattern(List=graft, CullPattern=or)
preview_2 = CustomPreview(Geometry=cull_2, Material=ColourSwatch(SwatchColor=RGBA(121, 128, 128, 152)))
