# Grasshopper definition test.gh (Grasshopper 1.0.7)

crv = Curve(<curve referenced from the Rhino model>)
range = Range(Domain=Domain(0, 1), Steps=expr("x-1", "10"))
graph = GraphMapper(range, x0=0, x1=1, y0=0, y1=1, container_name="Bezier", cpx=[0, 0, 1, 1], cpy=[0, 0.8091786504, 0.3743960857, 1])
offset = OffsetCurve(Curve=crv, Distance=Slider(10, range=0..10), Corners=1)
dom = ConstructDomain(DomainStart=0, DomainEnd="10")
remap = RemapNumbers(Value=graph, Source=Domain(0, 1), Target=dom)  # -> Mapped, Clipped
divide = DivideCurve(Curve=offset, Count="10", Kinks=False)  # -> Points, Tangents, Parameters
divide_2 = DivideCurve(Curve=crv, Count="10", Kinks=False)  # -> Points, Tangents, Parameters
sph = Sphere(Base=divide.Points, Radius="10")
sph_2 = Sphere(Base=divide_2.Points, Radius=remap.Mapped)
